# Grasshopper definition Grasshopper.gh (Grasshopper 1.0.7)
# plug-ins: Bifocals, Rhino.Inside for Autodesk Revit, ClipperComponents, ggRhinoIFC

gggrasshoppersettings = GgGrasshopperSettings(
    SettingsData_IFCSettings_Format="STEP",
    SettingsData_IFCSettings_GenerateOwnerHistory=True,
    SettingsData_IFCSettings_IdentifyObsolete=False,
    SettingsData_IFCSettings_LastUsedUnits="Millimeters",
    SettingsData_IFCSettings_ModelViewDefinition="Ifc2x3Coordination",
    SettingsData_IFCSettings_Radians=True,
    SettingsData_RevitSettings_Format="STEP",
    SettingsData_RevitSettings_GenerateOwnerHistory=True,
    SettingsData_RevitSettings_IdentifyObsolete=True,
    SettingsData_RevitSettings_LastUsedUnits="Millimeters",
    SettingsData_RevitSettings_ModelViewDefinition="Ifc4DesignTransfer",
    SettingsData_RevitSettings_Radians=True)
unit_x = UnitX(Factor=expr("-x", Slider(100, range=0..100)))
unit_y = UnitY(Factor=Slider(100, range=0..100))
unit_y_2 = UnitY(Factor=expr("-x", Slider(100, range=0..100)))
unit_x_2 = UnitX(Factor=expr("-x", Slider(100, range=0..100)))
panel = Panel("""4
5
6""")
panel_2 = Panel("""7
8""")
panel_3 = Panel("""1
2
3""")
unit_x_3 = UnitX(Factor=expr("-x", Slider(50, range=0..100)))
unit_y_3 = UnitY(Factor=expr("-x", Slider(50, range=0..100)))
unit_y_4 = UnitY(Factor=Slider(50, range=0..100))
unit_x_4 = UnitX(Factor=Slider(50, range=0..100))
ggifc_building = GgIFCBuilding(Name="test building", LongName="GH Building", BuildingComposition=3, ElevationOfRefHeight=0, ElevationOfTerrain=0)
xy_plane = XYPlane(Origin=Point(0, 0, 0))
ggifc_project = GgIFCProject(Name="house project")
ggifc_baketofile = GgIFCBaketoFile()
number_slider = Slider(1, range=0..10)  # disabled
number_slider_2 = Slider(1, range=0..1)  # disabled
number_slider_3 = Slider(4, range=0..10)  # disabled
number_slider_4 = Slider(10, range=0..10)  # disabled
number_slider_5 = Slider(56, range=0..100)  # disabled
number_slider_6 = Slider(5, range=0..100)  # disabled
toggle = BooleanToggle(True)  # disabled
swatch = ColourSwatch(SwatchColor=RGBA(255, 111, 0, 107))  # disabled
swatch_2 = ColourSwatch(SwatchColor=RGBA(255, 255, 0, 107))  # disabled

# ----
# FLOOR PLATE
number_slider_7 = Slider(10800, range=0..100000)
rectangle = Rectangle(Plane=PlaneXY(0, 0, 0), XSize=number_slider_7, YSize=Slider(9600, range=0..10000), Radius=0)  # -> Rectangle, Length
explode = Explode(Curve=rectangle.Rectangle, Recursive=True)  # -> Segments, Vertices
panel_4 = Panel("""1
2
3""")
panel_5 = Panel("""3
0""")
list_item = ListItem(List=explode.Segments, Index=panel_4, Wrap=True)
list_item_2 = ListItem(List=explode.Segments, Index=panel_5, Wrap=True)
number_slider_8 = Slider(1000, range=0..1000)
join_curves = JoinCurves(Curves=list_item, Preserve=False)
join_curves_2 = JoinCurves(Curves=list_item_2, Preserve=False)
fillet = Fillet(Curve=join_curves_2, Radius=number_slider_8)
fillet_2 = Fillet(Curve=join_curves, Radius=number_slider_8)
join_curves_3 = JoinCurves(Curves=[fillet_2, fillet], Preserve=False)
boundary_surfaces = BoundarySurfaces(Edges=join_curves_3)
area = Area(Geometry=boundary_surfaces)  # -> Area, Centroid
unit_z = UnitZ(Factor=expr("-x", Slider(250, range=0..1000)))

# ----
# SLAB
number_slider_9 = Slider(15600, range=0..100000)
rectangle_2 = Rectangle(Plane=PlaneXY(0, 0, 0), XSize=number_slider_9, YSize=Slider(14400, range=0..100000), Radius=0)  # -> Rectangle, Length
area_2 = Area(Geometry=rectangle_2.Rectangle)  # -> Area, Centroid
boundary_surfaces_2 = BoundarySurfaces(Edges=rectangle_2.Rectangle)
unit_z_2 = UnitZ(Factor=expr("-x", Slider(250, range=0..1000)))

# ----
# ROOF
number_slider_10 = Slider(2550, range=0..10000)
unit_z_3 = UnitZ(Factor=number_slider_10)
move = Move(Geometry=boundary_surfaces_2, Motion=unit_z_3)  # -> Geometry, Transform
deconstruct_brep = DeconstructBrep(Brep=boundary_surfaces_2)  # -> Faces, Edges, Vertices
list_item_3 = ListItem(List=deconstruct_brep.Edges, Index=Slider(6, range=0..10), Wrap=True)
rotate_axis = RotateAxis(Geometry=move.Geometry, Angle=degrees(Slider(7, range=0..10)), Axis=list_item_3)  # -> Geometry, Transform
unit_z_4 = UnitZ(Factor=Slider(200, range=0..1000))
extrude = Extrude(Base=rotate_axis.Geometry, Direction=unit_z_4)

vector_2pt = Vector2Pt(PointA=area.Centroid, PointB=area_2.Centroid, Unitize=False)  # -> Vector, Length
move_2 = Move(Geometry=boundary_surfaces, Motion=vector_2pt.Vector)  # -> Geometry, Transform
boundary_surfaces_3 = BoundarySurfaces(Edges=move_2.Geometry)
extrude_2 = Extrude(Base=boundary_surfaces_3, Direction=unit_z)

# ----
# EXTERIOR WALLS
number_slider_11 = Slider(500, range=0..1000)
offset_curve = OffsetCurve(Curve=move_2.Geometry, Distance=expr("-x", number_slider_11), Corners=1)
boundary_surfaces_4 = BoundarySurfaces(Edges=offset_curve)
solid_difference = SolidDifference(BrepsA=boundary_surfaces_3, BrepsB=boundary_surfaces_4)
unit_z_5 = UnitZ(Factor=Slider(6000, range=0..10000))
extrude_3 = Extrude(Base=solid_difference, Direction=unit_z_5)
solid_difference_2 = SolidDifference(BrepsA=extrude_3, BrepsB=rotate_axis.Geometry)
solid_difference_3 = SolidDifference(BrepsA=extrude_3, BrepsB=solid_difference_2)

solid_difference_4 = SolidDifference(BrepsA=boundary_surfaces_2, BrepsB=boundary_surfaces_3)
extrude_4 = Extrude(Base=solid_difference_4, Direction=unit_z_2)

# ----
# INTERIOR WALLS
number_slider_12 = Slider(35250, range=0..100000)
evaluate_curve = EvaluateCurve(Curve=offset_curve, Parameter=number_slider_12)  # -> Point, Tangent, Angle
evaluate_curve_2 = EvaluateCurve(Curve=offset_curve, Parameter=Slider(12850, range=0..100000))  # -> Point, Tangent, Angle
unit_y_5 = UnitY(Factor=expr("-x", Slider(4500, range=0..10000)))
unit_y_6 = UnitY(Factor=Slider(3100, range=0..10000))
evaluate_curve_3 = EvaluateCurve(Curve=offset_curve, Parameter=Slider(5000, range=0..10000))  # -> Point, Tangent, Angle
evaluate_curve_4 = EvaluateCurve(Curve=offset_curve, Parameter=Slider(6000, range=0..10000))  # -> Point, Tangent, Angle
evaluate_curve_5 = EvaluateCurve(Curve=offset_curve, Parameter=Slider(31850, range=0..100000))  # -> Point, Tangent, Angle
unit_y_7 = UnitY(Factor=expr("-x", Slider(1940, range=0..10000)))
unit_x_5 = UnitX(Factor=Slider(2260, range=0..10000))
evaluate_curve_6 = EvaluateCurve(Curve=offset_curve, Parameter=Slider(26150, range=0..100000))  # -> Point, Tangent, Angle
evaluate_curve_7 = EvaluateCurve(Curve=offset_curve, Parameter=Slider(33000, range=0..100000))  # -> Point, Tangent, Angle
unit_y_8 = UnitY(Factor=Slider(1100, range=0..10000))
move_3 = Move(Geometry=evaluate_curve.Point, Motion=unit_y_5)  # -> Geometry, Transform
point = Point(move_3.Geometry)
move_4 = Move(Geometry=evaluate_curve_2.Point, Motion=unit_y_6)  # -> Geometry, Transform
move_5 = Move(Geometry=evaluate_curve_5.Point, Motion=unit_y_7)  # -> Geometry, Transform
move_6 = Move(Geometry=point, Motion=unit_x_5)  # -> Geometry, Transform
unit_y_9 = UnitY(Factor=expr("-x", Slider(1000, range=0..1000)))
line = Line(StartPoint=evaluate_curve.Point, EndPoint=move_3.Geometry)
evaluate_curve_8 = EvaluateCurve(Curve=line, Parameter=Slider(0.878, range=0..1))  # -> Point, Tangent, Angle
line_2 = Line(StartPoint=evaluate_curve_2.Point, EndPoint=move_4.Geometry)
evaluate_curve_9 = EvaluateCurve(Curve=offset_curve, Parameter=Slider(1600, range=0..10000))  # -> Point, Tangent, Angle
evaluate_curve_10 = EvaluateCurve(Curve=line, Parameter=Slider(0.25, range=0..1))  # -> Point, Tangent, Angle
line_3 = Line(StartPoint=move_3.Geometry, EndPoint=evaluate_curve_3.Point)
line_4 = Line(StartPoint=move_4.Geometry, EndPoint=evaluate_curve_4.Point)
line_5 = Line(StartPoint=evaluate_curve_5.Point, EndPoint=move_5.Geometry)
line_6 = Line(StartPoint=point, EndPoint=move_6.Geometry)
evaluate_curve_11 = EvaluateCurve(Curve=line_6, Parameter=Slider(0.5, range=0..1))  # -> Point, Tangent, Angle
move_7 = Move(Geometry=evaluate_curve_11.Point, Motion=unit_y_8)  # -> Geometry, Transform
line_7 = Line(StartPoint=move_5.Geometry, EndPoint=evaluate_curve_6.Point)
line_8 = Line(StartPoint=move_6.Geometry, EndPoint=evaluate_curve_7.Point)
evaluate_curve_12 = EvaluateCurve(Curve=line_8, Parameter=Slider(0.245, range=0..1))  # -> Point, Tangent, Angle
line_9 = Line(StartPoint=evaluate_curve_11.Point, EndPoint=move_7.Geometry)
line_10 = Line(StartPoint=move_7.Geometry, EndPoint=evaluate_curve_12.Point)
join_curves_4 = JoinCurves(Curves=[line, line_3], Preserve=False)
join_curves_5 = JoinCurves(Curves=[line_2, line_4], Preserve=False)
join_curves_6 = JoinCurves(Curves=[line_5, line_7], Preserve=False)
explode_2 = Explode(Curve=join_curves_6, Recursive=True)  # -> Segments, Vertices
list_item_4 = ListItem(List=explode_2.Vertices, Index=Slider(1, range=0..10), Wrap=True)
move_8 = Move(Geometry=list_item_4, Motion=unit_y_9)  # -> Geometry, Transform
join_curves_7 = JoinCurves(Curves=[line_6, line_8], Preserve=False)
line_11 = Line(StartPoint=list_item_4, EndPoint=move_8.Geometry)
join_curves_8 = JoinCurves(Curves=[line_9, line_10], Preserve=False)
evaluate_curve_13 = EvaluateCurve(Curve=join_curves_8, Parameter=Slider(550, range=0..1000))  # -> Point, Tangent, Angle
line_12 = Line(StartPoint=evaluate_curve_13.Point, EndPoint=evaluate_curve_8.Point)
line_13 = Line(StartPoint=evaluate_curve_9.Point, EndPoint=evaluate_curve_10.Point)
offset_curve_2 = OffsetCurve(Curve=join_curves_4, Distance=expr("-x", Slider(100, range=0..100)), Corners=1)
offset_curve_3 = OffsetCurve(Curve=join_curves_5, Distance=expr("-x", Slider(100, range=0..100)), Corners=1)
offset_curve_4 = OffsetCurve(Curve=join_curves_6, Distance=expr("-x", Slider(100, range=0..100)), Corners=1)
offset_curve_5 = OffsetCurve(Curve=join_curves_7, Distance=expr("-x", Slider(100, range=0..100)), Corners=1)
offset_curve_6 = OffsetCurve(Curve=line_11, Distance=expr("-x", Slider(100, range=0..100)), Corners=1)
offset_curve_7 = OffsetCurve(Curve=line_12, Distance=expr("-x", Slider(100, range=0..100)), Corners=1)
offset_curve_8 = OffsetCurve(Curve=join_curves_8, Distance=expr("-x", Slider(100, range=0..100)), Corners=1)
offset_curve_9 = OffsetCurve(Curve=line_13, Distance=Slider(100, range=0..100), Corners=1)
explode_3 = Explode(Curve=offset_curve_2, Recursive=True)  # -> Segments, Vertices
explode_4 = Explode(Curve=offset_curve_3, Recursive=True)  # -> Segments, Vertices
explode_5 = Explode(Curve=offset_curve_4, Recursive=True)  # -> Segments, Vertices
explode_6 = Explode(Curve=offset_curve_5, Recursive=True)  # -> Segments, Vertices
explode_7 = Explode(Curve=offset_curve_6, Recursive=True)  # -> Segments, Vertices
explode_8 = Explode(Curve=offset_curve_7, Recursive=True)  # -> Segments, Vertices
explode_9 = Explode(Curve=offset_curve_8, Recursive=True)  # -> Segments, Vertices
explode_10 = Explode(Curve=offset_curve_9, Recursive=True)  # -> Segments, Vertices
list_item_5 = ListItem(List=explode_3.Vertices, Index=Slider(0, range=0..10), Wrap=True)
list_item_6 = ListItem(List=explode_3.Vertices, Index=Slider(2, range=0..10), Wrap=True)
list_item_7 = ListItem(List=explode_4.Vertices, Index=Slider(0, range=0..10), Wrap=True)
list_item_8 = ListItem(List=explode_4.Vertices, Index=Slider(2, range=0..10), Wrap=True)
list_item_9 = ListItem(List=explode_5.Vertices, Index=Slider(0, range=0..10), Wrap=True)
list_item_10 = ListItem(List=explode_5.Vertices, Index=Slider(2, range=0..10), Wrap=True)
list_item_11 = ListItem(List=explode_6.Vertices, Index=Slider(0, range=0..10), Wrap=True)
list_item_12 = ListItem(List=explode_6.Vertices, Index=Slider(2, range=0..10), Wrap=True)
list_item_13 = ListItem(List=explode_7.Vertices, Index=Slider(0, range=0..10), Wrap=True)
list_item_14 = ListItem(List=explode_7.Vertices, Index=Slider(1, range=0..10), Wrap=True)
list_item_15 = ListItem(List=explode_8.Vertices, Index=Slider(0, range=0..10), Wrap=True)
list_item_16 = ListItem(List=explode_8.Vertices, Index=Slider(1, range=0..10), Wrap=True)
list_item_17 = ListItem(List=explode_9.Vertices, Index=Slider(0, range=0..10), Wrap=True)
list_item_18 = ListItem(List=explode_9.Vertices, Index=Slider(2, range=0..10), Wrap=True)
line_14 = Line(StartPoint=list_item_4, EndPoint=list_item_13)
list_item_19 = ListItem(List=explode_10.Vertices, Index=Slider(0, range=0..10), Wrap=True)
list_item_20 = ListItem(List=explode_10.Vertices, Index=Slider(1, range=0..10), Wrap=True)
line_15 = Line(StartPoint=evaluate_curve.Point, EndPoint=list_item_5)
line_16 = Line(StartPoint=evaluate_curve_3.Point, EndPoint=list_item_6)
line_17 = Line(StartPoint=evaluate_curve_2.Point, EndPoint=list_item_7)
line_18 = Line(StartPoint=evaluate_curve_4.Point, EndPoint=list_item_8)
line_19 = Line(StartPoint=evaluate_curve_5.Point, EndPoint=list_item_9)
line_20 = Line(StartPoint=evaluate_curve_6.Point, EndPoint=list_item_10)
line_21 = Line(StartPoint=point, EndPoint=list_item_11)
line_22 = Line(StartPoint=evaluate_curve_7.Point, EndPoint=list_item_12)
line_23 = Line(StartPoint=move_8.Geometry, EndPoint=list_item_14)
line_24 = Line(StartPoint=evaluate_curve_10.Point, EndPoint=list_item_20)
line_25 = Line(StartPoint=evaluate_curve_13.Point, EndPoint=list_item_15)
line_26 = Line(StartPoint=evaluate_curve_8.Point, EndPoint=list_item_16)
line_27 = Line(StartPoint=evaluate_curve_11.Point, EndPoint=list_item_17)
line_28 = Line(StartPoint=evaluate_curve_12.Point, EndPoint=list_item_18)
line_29 = Line(StartPoint=evaluate_curve_9.Point, EndPoint=list_item_19)
join_curves_9 = JoinCurves(Curves=flatten([line, line_3, offset_curve_2, line_15, line_16]), Preserve=False)
join_curves_10 = JoinCurves(Curves=flatten([line_2, line_4, offset_curve_3, line_17, line_18]), Preserve=False)
join_curves_11 = JoinCurves(Curves=flatten([line_5, line_7, offset_curve_4, line_19, line_20]), Preserve=False)
join_curves_12 = JoinCurves(Curves=flatten([line_23, line_14, line_11, offset_curve_6]), Preserve=False)
join_curves_13 = JoinCurves(Curves=flatten([line_6, line_8, offset_curve_5, line_21, line_22]), Preserve=False)
join_curves_14 = JoinCurves(Curves=flatten([line_24, line_29, line_13, offset_curve_9]), Preserve=False)
join_curves_15 = JoinCurves(Curves=flatten([line_12, offset_curve_7, line_25, line_26]), Preserve=False)
join_curves_16 = JoinCurves(Curves=flatten([line_9, line_10, offset_curve_8, line_27, line_28]), Preserve=False)
boundary_surfaces_5 = BoundarySurfaces(Edges=join_curves_9)
boundary_surfaces_6 = BoundarySurfaces(Edges=join_curves_10)
unit_z_6 = UnitZ(Factor=Slider(6000, range=0..10000))
unit_z_7 = UnitZ(Factor=Slider(6000, range=0..10000))
boundary_surfaces_7 = BoundarySurfaces(Edges=join_curves_11)
boundary_surfaces_8 = BoundarySurfaces(Edges=join_curves_12)
boundary_surfaces_9 = BoundarySurfaces(Edges=join_curves_13)
unit_z_8 = UnitZ(Factor=Slider(6000, range=0..10000))
unit_z_9 = UnitZ(Factor=Slider(6000, range=0..10000))
unit_z_10 = UnitZ(Factor=Slider(6000, range=0..10000))
boundary_surfaces_10 = BoundarySurfaces(Edges=join_curves_14)
boundary_surfaces_11 = BoundarySurfaces(Edges=join_curves_15)
boundary_surfaces_12 = BoundarySurfaces(Edges=join_curves_16)
unit_z_11 = UnitZ(Factor=Slider(6000, range=0..10000))
unit_z_12 = UnitZ(Factor=Slider(6000, range=0..10000))
unit_z_13 = UnitZ(Factor=Slider(6000, range=0..10000))
extrude_5 = Extrude(Base=boundary_surfaces_5, Direction=unit_z_6)
extrude_6 = Extrude(Base=boundary_surfaces_6, Direction=unit_z_7)
extrude_7 = Extrude(Base=boundary_surfaces_7, Direction=unit_z_8)
extrude_8 = Extrude(Base=boundary_surfaces_8, Direction=unit_z_9)
extrude_9 = Extrude(Base=boundary_surfaces_9, Direction=unit_z_10)
extrude_10 = Extrude(Base=boundary_surfaces_10, Direction=unit_z_11)
extrude_11 = Extrude(Base=boundary_surfaces_11, Direction=unit_z_12)
extrude_12 = Extrude(Base=boundary_surfaces_12, Direction=unit_z_13)
solid_difference_5 = SolidDifference(BrepsA=extrude_5, BrepsB=rotate_axis.Geometry)
solid_difference_6 = SolidDifference(BrepsA=extrude_6, BrepsB=rotate_axis.Geometry)
solid_difference_7 = SolidDifference(BrepsA=extrude_7, BrepsB=rotate_axis.Geometry)
solid_difference_8 = SolidDifference(BrepsA=extrude_8, BrepsB=rotate_axis.Geometry)
solid_difference_9 = SolidDifference(BrepsA=extrude_9, BrepsB=rotate_axis.Geometry)
solid_difference_10 = SolidDifference(BrepsA=extrude_10, BrepsB=rotate_axis.Geometry)
solid_difference_11 = SolidDifference(BrepsA=extrude_11, BrepsB=rotate_axis.Geometry)
solid_difference_12 = SolidDifference(BrepsA=extrude_12, BrepsB=rotate_axis.Geometry)
solid_difference_13 = SolidDifference(BrepsA=extrude_5, BrepsB=solid_difference_5)
solid_difference_14 = SolidDifference(BrepsA=extrude_6, BrepsB=solid_difference_6)
solid_difference_15 = SolidDifference(BrepsA=extrude_7, BrepsB=solid_difference_7)
solid_difference_16 = SolidDifference(BrepsA=extrude_8, BrepsB=solid_difference_8)
solid_difference_17 = SolidDifference(BrepsA=extrude_9, BrepsB=solid_difference_9)
solid_difference_18 = SolidDifference(BrepsA=extrude_10, BrepsB=solid_difference_10)
solid_difference_19 = SolidDifference(BrepsA=extrude_11, BrepsB=solid_difference_11)
solid_difference_20 = SolidDifference(BrepsA=extrude_12, BrepsB=solid_difference_12)

custom_preview = CustomPreview(Geometry=extrude_4, Material=ColourSwatch(SwatchColor=RGB(89, 89, 89)))

query_materials = QueryMaterials()
list_item_21 = ListItem(Index=Slider(73, range=0..100), Wrap=True)
panel_6 = Panel(list_item_21)
add_geometry_directshape = AddGeometryDirectShape(Name="SLAB", Geometry=extrude_4, Material=list_item_21, TrackingMode=2)

# ----
# CARPORT
number_slider_13 = Slider(8400, range=0..10000)
rectangle_3 = Rectangle(Plane=PlaneXY(0, 0, 0), XSize=number_slider_13, YSize=Slider(6900, range=0..10000), Radius=0)  # -> Rectangle, Length
deconstruct_brep_2 = DeconstructBrep(Brep=rectangle_3.Rectangle)  # -> Faces, Edges, Vertices
list_item_22 = ListItem(List=deconstruct_brep_2.Edges, Index=Slider(2, range=0..10), Wrap=True)
rotate_axis_2 = RotateAxis(Geometry=rectangle_3.Rectangle, Angle=degrees(Slider(-7, range=-10..10)), Axis=list_item_22)  # -> Geometry, Transform
explode_11 = Explode(Curve=rotate_axis_2.Geometry, Recursive=True)  # -> Segments, Vertices
explode_12 = Explode(Curve=boundary_surfaces_3, Recursive=True)  # -> Segments, Vertices
list_item_23 = ListItem(List=explode_11.Vertices, Index=Slider(2, range=0..3), Wrap=True)
list_item_24 = ListItem(List=explode_12.Vertices, Index=Slider(3, range=0..8), Wrap=True)
vector_2pt_2 = Vector2Pt(PointA=list_item_23, PointB=list_item_24, Unitize=False)  # -> Vector, Length
move_9 = Move(Geometry=rotate_axis_2.Geometry, Motion=vector_2pt_2.Vector)  # -> Geometry, Transform
unit_z_14 = UnitZ(Factor=Slider(3120, range=0..10000))
boundary_surfaces_13 = BoundarySurfaces(Edges=move_9.Geometry)
move_10 = Move(Geometry=boundary_surfaces_13, Motion=unit_z_14)  # -> Geometry, Transform
unit_z_15 = UnitZ(Factor=Slider(200, range=0..1000))
extrude_13 = Extrude(Base=move_10.Geometry, Direction=unit_z_15)

custom_preview_2 = CustomPreview(Geometry=extrude, Material=ColourSwatch(SwatchColor=RGB(29, 39, 89)))

custom_preview_3 = CustomPreview(Geometry=extrude_2, Material=ColourSwatch(SwatchColor=RGB(143, 140, 103)))

query_materials_2 = QueryMaterials()
list_item_25 = ListItem(Index=Slider(23, range=0..100), Wrap=True)
panel_7 = Panel(list_item_25)
add_geometry_directshape_2 = AddGeometryDirectShape(Name="FLOOR PLATE", Geometry=extrude_2, Material=list_item_25, TrackingMode=2)

query_materials_3 = QueryMaterials()
list_item_26 = ListItem(Index=Slider(29, range=0..100), Wrap=True)
panel_8 = Panel(list_item_26)
add_geometry_directshape_3 = AddGeometryDirectShape(Name="ROOF", Geometry=extrude, Material=list_item_26, TrackingMode=2)

# ----
# EXTERIOR WALL CUTOUTS
number_slider_14 = Slider(500, range=0..1000)
explode_13 = Explode(Curve=move_2.Geometry, Recursive=True)  # -> Segments, Vertices
number_slider_15 = Slider(14500, range=0..100000)
number_slider_16 = Slider(12700, range=0..100000)
number_slider_17 = Slider(8380, range=0..10000)
number_slider_18 = Slider(6000, range=0..10000)
number_slider_19 = Slider(31920, range=0..100000)
number_slider_20 = Slider(3800, range=0..10000)
number_slider_21 = Slider(35350, range=0..100000)
number_slider_22 = Slider(29500, range=0..100000)
explode_14 = Explode(Curve=move_2.Geometry, Recursive=True)  # -> Segments, Vertices
number_slider_23 = Slider(33500, range=0..100000)
number_slider_24 = Slider(26250, range=0..100000)
number_slider_25 = Slider(23000, range=0..100000)
list_item_27 = ListItem(List=explode_13.Vertices, Index="3", Wrap=True)
unit_y_10 = UnitY(Factor=expr("-x", number_slider_14))
unit_x_6 = UnitX(Factor=expr("-x", Slider(1000, range=0..1000)))
evaluate_curve_14 = EvaluateCurve(Curve=offset_curve, Parameter=number_slider_15)  # -> Point, Tangent, Angle
evaluate_curve_15 = EvaluateCurve(Curve=offset_curve, Parameter=number_slider_16)  # -> Point, Tangent, Angle
evaluate_curve_16 = EvaluateCurve(Curve=offset_curve, Parameter=number_slider_17)  # -> Point, Tangent, Angle
evaluate_curve_17 = EvaluateCurve(Curve=offset_curve, Parameter=number_slider_18)  # -> Point, Tangent, Angle
unit_y_11 = UnitY(Factor=Slider(1000, range=0..1000))
unit_y_12 = UnitY(Factor=Slider(1000, range=0..1000))
list_item_28 = ListItem(List=explode_14.Vertices, Index="3", Wrap=True)
evaluate_curve_18 = EvaluateCurve(Curve=offset_curve, Parameter=number_slider_20)  # -> Point, Tangent, Angle
evaluate_curve_19 = EvaluateCurve(Curve=offset_curve, Parameter=number_slider_19)  # -> Point, Tangent, Angle
evaluate_curve_20 = EvaluateCurve(Curve=offset_curve, Parameter=number_slider_21)  # -> Point, Tangent, Angle
unit_x_7 = UnitX(Factor=expr("-x", Slider(1000, range=0..1000)))
unit_y_13 = UnitY(Factor=Slider(1000, range=0..1000))
unit_x_8 = UnitX(Factor=expr("-x", Slider(1000, range=0..1000)))
evaluate_curve_21 = EvaluateCurve(Curve=offset_curve, Parameter=number_slider_22)  # -> Point, Tangent, Angle
unit_x_9 = UnitX(Factor=expr("-x", Slider(1000, range=0..1000)))
evaluate_curve_22 = EvaluateCurve(Curve=offset_curve, Parameter=number_slider_23)  # -> Point, Tangent, Angle
evaluate_curve_23 = EvaluateCurve(Curve=offset_curve, Parameter=number_slider_24)  # -> Point, Tangent, Angle
unit_x_10 = UnitX(Factor=expr("-x", Slider(500, range=0..1000)))
unit_y_14 = UnitY(Factor=Slider(1000, range=0..1000))
evaluate_curve_24 = EvaluateCurve(Curve=offset_curve, Parameter=number_slider_25)  # -> Point, Tangent, Angle
unit_y_15 = UnitY(Factor=Slider(2500, range=0..10000))
unit_y_16 = UnitY(Factor=Slider(1000, range=0..1000))
move_11 = Move(Geometry=evaluate_curve_14.Point, Motion=unit_y_10)  # -> Geometry, Transform
move_12 = Move(Geometry=evaluate_curve_15.Point, Motion=unit_x_6)  # -> Geometry, Transform
unit_y_17 = UnitY(Factor=expr("-x", Slider(500, range=0..1000)))
unit_y_18 = UnitY(Factor=number_slider_14)
move_13 = Move(Geometry=evaluate_curve_16.Point, Motion=unit_y_11)  # -> Geometry, Transform
move_14 = Move(Geometry=evaluate_curve_17.Point, Motion=unit_y_12)  # -> Geometry, Transform
unit_x_11 = UnitX(Factor=expr("-x", Slider(500, range=0..1000)))
unit_x_12 = UnitX(Factor=expr("-x", Slider(500, range=0..1000)))
move_15 = Move(Geometry=evaluate_curve_18.Point, Motion=unit_y_13)  # -> Geometry, Transform
move_16 = Move(Geometry=evaluate_curve_19.Point, Motion=unit_x_7)  # -> Geometry, Transform
move_17 = Move(Geometry=evaluate_curve_20.Point, Motion=unit_x_8)  # -> Geometry, Transform
unit_x_13 = UnitX(Factor=expr("-x", Slider(500, range=0..1000)))
unit_y_19 = UnitY(Factor=Slider(500, range=0..1000))
unit_y_20 = UnitY(Factor=Slider(500, range=0..1000))
move_18 = Move(Geometry=evaluate_curve_21.Point, Motion=unit_x_9)  # -> Geometry, Transform
unit_y_21 = UnitY(Factor=Slider(500, range=0..1000))
move_19 = Move(Geometry=evaluate_curve_22.Point, Motion=unit_x_10)  # -> Geometry, Transform
move_20 = Move(Geometry=evaluate_curve_23.Point, Motion=unit_y_14)  # -> Geometry, Transform
unit_y_22 = UnitY(Factor=Slider(500, range=0..1000))
unit_x_14 = UnitX(Factor=Slider(500, range=0..1000))
move_21 = Move(Geometry=evaluate_curve_24.Point, Motion=unit_y_16)  # -> Geometry, Transform
unit_x_15 = UnitX(Factor=Slider(500, range=0..1000))
move_22 = Move(Geometry=list_item_27, Motion=expr("-x", unit_x_15))  # -> Geometry, Transform
move_23 = Move(Geometry=move_22.Geometry, Motion=unit_y_15)  # -> Geometry, Transform
unit_x_16 = UnitX(Factor=Slider(500, range=0..1000))
line_30 = Line(StartPoint=evaluate_curve_14.Point, EndPoint=move_11.Geometry)
line_31 = Line(StartPoint=evaluate_curve_15.Point, EndPoint=move_12.Geometry)
move_24 = Move(Geometry=list_item_28, Motion=unit_y_18)  # -> Geometry, Transform
move_25 = Move(Geometry=move_12.Geometry, Motion=unit_y_17)  # -> Geometry, Transform
move_26 = Move(Geometry=evaluate_curve_15.Point, Motion=unit_y_17)  # -> Geometry, Transform
line_32 = Line(StartPoint=evaluate_curve_16.Point, EndPoint=move_13.Geometry)
line_33 = Line(StartPoint=evaluate_curve_17.Point, EndPoint=move_14.Geometry)
move_27 = Move(Geometry=move_13.Geometry, Motion=unit_x_11)  # -> Geometry, Transform
move_28 = Move(Geometry=evaluate_curve_16.Point, Motion=unit_x_11)  # -> Geometry, Transform
move_29 = Move(Geometry=move_14.Geometry, Motion=unit_x_12)  # -> Geometry, Transform
move_30 = Move(Geometry=evaluate_curve_17.Point, Motion=unit_x_12)  # -> Geometry, Transform
line_34 = Line(StartPoint=evaluate_curve_18.Point, EndPoint=move_15.Geometry)
line_35 = Line(StartPoint=evaluate_curve_19.Point, EndPoint=move_16.Geometry)
move_31 = Move(Geometry=move_15.Geometry, Motion=unit_x_13)  # -> Geometry, Transform
line_36 = Line(StartPoint=evaluate_curve_20.Point, EndPoint=move_17.Geometry)
move_32 = Move(Geometry=move_16.Geometry, Motion=unit_y_19)  # -> Geometry, Transform
move_33 = Move(Geometry=move_17.Geometry, Motion=unit_y_20)  # -> Geometry, Transform
move_34 = Move(Geometry=evaluate_curve_18.Point, Motion=unit_x_13)  # -> Geometry, Transform
move_35 = Move(Geometry=evaluate_curve_19.Point, Motion=unit_y_19)  # -> Geometry, Transform
move_36 = Move(Geometry=evaluate_curve_20.Point, Motion=unit_y_20)  # -> Geometry, Transform
line_37 = Line(StartPoint=evaluate_curve_21.Point, EndPoint=move_18.Geometry)
move_37 = Move(Geometry=move_18.Geometry, Motion=unit_y_21)  # -> Geometry, Transform
move_38 = Move(Geometry=evaluate_curve_21.Point, Motion=unit_y_21)  # -> Geometry, Transform
line_38 = Line(StartPoint=evaluate_curve_22.Point, EndPoint=move_19.Geometry)
move_39 = Move(Geometry=move_19.Geometry, Motion=unit_y_22)  # -> Geometry, Transform
line_39 = Line(StartPoint=evaluate_curve_23.Point, EndPoint=move_20.Geometry)
move_40 = Move(Geometry=evaluate_curve_22.Point, Motion=unit_y_22)  # -> Geometry, Transform
move_41 = Move(Geometry=move_20.Geometry, Motion=unit_x_14)  # -> Geometry, Transform
move_42 = Move(Geometry=evaluate_curve_23.Point, Motion=unit_x_14)  # -> Geometry, Transform
line_40 = Line(StartPoint=move_22.Geometry, EndPoint=move_23.Geometry)
line_41 = Line(StartPoint=evaluate_curve_24.Point, EndPoint=move_21.Geometry)
move_43 = Move(Geometry=move_23.Geometry, Motion=unit_x_15)  # -> Geometry, Transform
move_44 = Move(Geometry=move_21.Geometry, Motion=unit_x_16)  # -> Geometry, Transform
move_45 = Move(Geometry=evaluate_curve_24.Point, Motion=unit_x_16)  # -> Geometry, Transform
line_42 = Line(StartPoint=move_11.Geometry, EndPoint=list_item_28)
line_43 = Line(StartPoint=evaluate_curve_14.Point, EndPoint=move_24.Geometry)
line_44 = Line(StartPoint=move_12.Geometry, EndPoint=move_25.Geometry)
line_45 = Line(StartPoint=evaluate_curve_15.Point, EndPoint=move_26.Geometry)
line_46 = Line(StartPoint=move_13.Geometry, EndPoint=move_27.Geometry)
line_47 = Line(StartPoint=evaluate_curve_16.Point, EndPoint=move_28.Geometry)
line_48 = Line(StartPoint=move_14.Geometry, EndPoint=move_29.Geometry)
line_49 = Line(StartPoint=evaluate_curve_17.Point, EndPoint=move_30.Geometry)
line_50 = Line(StartPoint=move_15.Geometry, EndPoint=move_31.Geometry)
line_51 = Line(StartPoint=evaluate_curve_18.Point, EndPoint=move_34.Geometry)
line_52 = Line(StartPoint=move_16.Geometry, EndPoint=move_32.Geometry)
line_53 = Line(StartPoint=evaluate_curve_19.Point, EndPoint=move_35.Geometry)
line_54 = Line(StartPoint=move_17.Geometry, EndPoint=move_33.Geometry)
line_55 = Line(StartPoint=evaluate_curve_20.Point, EndPoint=move_36.Geometry)
line_56 = Line(StartPoint=move_18.Geometry, EndPoint=move_37.Geometry)
line_57 = Line(StartPoint=evaluate_curve_21.Point, EndPoint=move_38.Geometry)
line_58 = Line(StartPoint=move_19.Geometry, EndPoint=move_39.Geometry)
line_59 = Line(StartPoint=evaluate_curve_22.Point, EndPoint=move_40.Geometry)
line_60 = Line(StartPoint=move_20.Geometry, EndPoint=move_41.Geometry)
line_61 = Line(StartPoint=evaluate_curve_23.Point, EndPoint=move_42.Geometry)
line_62 = Line(StartPoint=move_23.Geometry, EndPoint=move_43.Geometry)
line_63 = Line(StartPoint=move_22.Geometry, EndPoint=list_item_27)
line_64 = Line(StartPoint=move_21.Geometry, EndPoint=move_44.Geometry)
line_65 = Line(StartPoint=evaluate_curve_24.Point, EndPoint=move_45.Geometry)
line_66 = Line(StartPoint=list_item_28, EndPoint=move_24.Geometry)
line_67 = Line(StartPoint=move_25.Geometry, EndPoint=move_26.Geometry)
line_68 = Line(StartPoint=move_27.Geometry, EndPoint=move_28.Geometry)
line_69 = Line(StartPoint=move_29.Geometry, EndPoint=move_30.Geometry)
line_70 = Line(StartPoint=move_31.Geometry, EndPoint=move_34.Geometry)
line_71 = Line(StartPoint=move_32.Geometry, EndPoint=move_35.Geometry)
line_72 = Line(StartPoint=move_33.Geometry, EndPoint=move_36.Geometry)
line_73 = Line(StartPoint=move_37.Geometry, EndPoint=move_38.Geometry)
line_74 = Line(StartPoint=move_39.Geometry, EndPoint=move_40.Geometry)
line_75 = Line(StartPoint=move_41.Geometry, EndPoint=move_42.Geometry)
line_76 = Line(StartPoint=move_43.Geometry, EndPoint=list_item_27)
line_77 = Line(StartPoint=move_44.Geometry, EndPoint=move_45.Geometry)
join_curves_17 = JoinCurves(Curves=[line_30, line_42, line_66, line_43], Preserve=False)
join_curves_18 = JoinCurves(Curves=[line_31, line_44, line_67, line_45], Preserve=False)
join_curves_19 = JoinCurves(Curves=[line_32, line_46, line_68, line_47], Preserve=False)
join_curves_20 = JoinCurves(Curves=[line_33, line_48, line_69, line_49], Preserve=False)
join_curves_21 = JoinCurves(Curves=[line_34, line_50, line_70, line_51], Preserve=False)
join_curves_22 = JoinCurves(Curves=[line_35, line_52, line_71, line_53], Preserve=False)
join_curves_23 = JoinCurves(Curves=[line_36, line_54, line_72, line_55], Preserve=False)
join_curves_24 = JoinCurves(Curves=[line_37, line_56, line_73, line_57], Preserve=False)
join_curves_25 = JoinCurves(Curves=[line_38, line_58, line_74, line_59], Preserve=False)
join_curves_26 = JoinCurves(Curves=[line_39, line_60, line_75, line_61], Preserve=False)
join_curves_27 = JoinCurves(Curves=[line_40, line_62, line_76, line_63], Preserve=False)
join_curves_28 = JoinCurves(Curves=[line_41, line_64, line_77, line_65], Preserve=False)
unit_z_16 = UnitZ(Factor=Slider(6000, range=0..10000))
unit_z_17 = UnitZ(Factor=Slider(6000, range=0..10000))
boundary_surfaces_14 = BoundarySurfaces(Edges=join_curves_17)
unit_z_18 = UnitZ(Factor=Slider(6000, range=0..10000))
boundary_surfaces_15 = BoundarySurfaces(Edges=join_curves_18)
unit_z_19 = UnitZ(Factor=Slider(6000, range=0..10000))
boundary_surfaces_16 = BoundarySurfaces(Edges=join_curves_19)
boundary_surfaces_17 = BoundarySurfaces(Edges=join_curves_20)
unit_z_20 = UnitZ(Factor=Slider(6000, range=0..10000))
unit_z_21 = UnitZ(Factor=Slider(6000, range=0..10000))
unit_z_22 = UnitZ(Factor=Slider(6000, range=0..10000))
boundary_surfaces_18 = BoundarySurfaces(Edges=join_curves_21)
boundary_surfaces_19 = BoundarySurfaces(Edges=join_curves_22)
boundary_surfaces_20 = BoundarySurfaces(Edges=join_curves_23)
unit_z_23 = UnitZ(Factor=Slider(6000, range=0..10000))
boundary_surfaces_21 = BoundarySurfaces(Edges=join_curves_24)
unit_z_24 = UnitZ(Factor=Slider(6000, range=0..10000))
unit_z_25 = UnitZ(Factor=Slider(6000, range=0..10000))
boundary_surfaces_22 = BoundarySurfaces(Edges=join_curves_25)
boundary_surfaces_23 = BoundarySurfaces(Edges=join_curves_26)
unit_z_26 = UnitZ(Factor=Slider(6000, range=0..10000))
unit_z_27 = UnitZ(Factor=Slider(6000, range=0..10000))
boundary_surfaces_24 = BoundarySurfaces(Edges=join_curves_27)
boundary_surfaces_25 = BoundarySurfaces(Edges=join_curves_28)
extrude_14 = Extrude(Base=boundary_surfaces_14, Direction=unit_z_16)
extrude_15 = Extrude(Base=boundary_surfaces_15, Direction=unit_z_17)
extrude_16 = Extrude(Base=boundary_surfaces_16, Direction=unit_z_18)
extrude_17 = Extrude(Base=boundary_surfaces_17, Direction=unit_z_19)
extrude_18 = Extrude(Base=boundary_surfaces_18, Direction=unit_z_20)
extrude_19 = Extrude(Base=boundary_surfaces_19, Direction=unit_z_21)
extrude_20 = Extrude(Base=boundary_surfaces_20, Direction=unit_z_22)
extrude_21 = Extrude(Base=boundary_surfaces_21, Direction=unit_z_23)
extrude_22 = Extrude(Base=boundary_surfaces_22, Direction=unit_z_24)
extrude_23 = Extrude(Base=boundary_surfaces_23, Direction=unit_z_25)
extrude_24 = Extrude(Base=boundary_surfaces_24, Direction=unit_z_26)
extrude_25 = Extrude(Base=boundary_surfaces_25, Direction=unit_z_27)
solid_difference_21 = SolidDifference(BrepsA=[extrude_16, extrude_17, extrude_18], BrepsB=rotate_axis.Geometry)
solid_difference_22 = SolidDifference(BrepsA=[extrude_14, extrude_15], BrepsB=rotate_axis.Geometry)
solid_difference_23 = SolidDifference(BrepsA=[extrude_23, extrude_25, extrude_24], BrepsB=rotate_axis.Geometry)
solid_difference_24 = SolidDifference(BrepsA=[extrude_20, extrude_19, extrude_21, extrude_22], BrepsB=rotate_axis.Geometry)
solid_difference_25 = SolidDifference(BrepsA=[extrude_16, extrude_17, extrude_18], BrepsB=solid_difference_21)
solid_difference_26 = SolidDifference(BrepsA=[extrude_14, extrude_15], BrepsB=solid_difference_22)
solid_difference_27 = SolidDifference(BrepsA=[extrude_23, extrude_25, extrude_24], BrepsB=solid_difference_23)
solid_difference_28 = SolidDifference(BrepsA=[extrude_20, extrude_19, extrude_21, extrude_22], BrepsB=solid_difference_24)
solid_difference_29 = SolidDifference(BrepsA=solid_difference_3, BrepsB=[solid_difference_26, solid_difference_25, solid_difference_28, solid_difference_27])

# ----
# CARPORT POLES
number_slider_26 = Slider(5, range=0..10)
deconstruct_brep_3 = DeconstructBrep(Brep=extrude_13)  # -> Faces, Edges, Vertices
list_item_29 = ListItem(List=deconstruct_brep_3.Faces, Index=number_slider_26, Wrap=True)
divide_surface = DivideSurface(Surface=list_item_29, UCount=10, VCount=10)  # -> flatten(Points), Normals, Parameters
list_item_30 = ListItem(List=divide_surface.Points, Index="12", Wrap=True)
list_item_31 = ListItem(List=divide_surface.Points, Index="100", Wrap=True)
circle = Circle(Plane=[list_item_31, list_item_30], Radius=Slider(150, range=0..1000))
unit_z_28 = UnitZ(Factor=expr("-x", Slider(2550, range=0..10000)))
extrude_26 = Extrude(Base=circle, Direction=unit_z_28)
solid_difference_30 = SolidDifference(BrepsA=extrude_26, BrepsB=move_10.Geometry)
solid_difference_31 = SolidDifference(BrepsA=extrude_26, BrepsB=solid_difference_30)
cap_holes = CapHoles(Brep=solid_difference_31)

custom_preview_4 = CustomPreview(Geometry=extrude_13, Material=ColourSwatch(SwatchColor=RGB(29, 39, 89)))

# ----
# DOOR CAVITIES/INTERIOR WALLS
number_slider_27 = Slider(1000, range=0..1000)
unit_x_17 = UnitX(Factor=expr("-x", Slider(1000, range=0..1000)))
unit_x_18 = UnitX(Factor=expr("-x", number_slider_27))
evaluate_curve_25 = EvaluateCurve(Curve=line_3, Parameter=Slider(0.65, range=0..1))  # -> Point, Tangent, Angle
unit_x_19 = UnitX(Factor=expr("-x", Slider(1000, range=0..1000)))
evaluate_curve_26 = EvaluateCurve(Curve=line_13, Parameter=Slider(0.35, range=0..1))  # -> Point, Tangent, Angle
evaluate_curve_27 = EvaluateCurve(Curve=line_4, Parameter=Slider(0.65, range=0..1))  # -> Point, Tangent, Angle
unit_x_20 = UnitX(Factor=Slider(1000, range=0..1000))
evaluate_curve_28 = EvaluateCurve(Curve=line_6, Parameter=Slider(0.45, range=0..1))  # -> Point, Tangent, Angle
evaluate_curve_29 = EvaluateCurve(Curve=line_5, Parameter=Slider(0.9, range=0..1))  # -> Point, Tangent, Angle
unit_y_23 = UnitY(Factor=Slider(1000, range=0..1000))
evaluate_curve_30 = EvaluateCurve(Curve=line_8, Parameter=Slider(0.02, range=0..0.1))  # -> Point, Tangent, Angle
evaluate_curve_31 = EvaluateCurve(Curve=line_8, Parameter=Slider(0.25, range=0..1))  # -> Point, Tangent, Angle
unit_y_24 = UnitY(Factor=Slider(900, range=0..1000))
unit_y_25 = UnitY(Factor=Slider(1000, range=0..1000))
move_46 = Move(Geometry=evaluate_curve_25.Point, Motion=unit_x_17)  # -> Geometry, Transform
move_47 = Move(Geometry=evaluate_curve_26.Point, Motion=unit_x_20)  # -> Geometry, Transform
unit_y_26 = UnitY(Factor=expr("-x", Slider(200, range=0..1000)))
move_48 = Move(Geometry=evaluate_curve_27.Point, Motion=unit_x_18)  # -> Geometry, Transform
unit_y_27 = UnitY(Factor=expr("-x", Slider(100, range=0..100)))
move_49 = Move(Geometry=evaluate_curve_28.Point, Motion=unit_x_19)  # -> Geometry, Transform
unit_y_28 = UnitY(Factor=Slider(100, range=0..100))
move_50 = Move(Geometry=evaluate_curve_29.Point, Motion=unit_y_23)  # -> Geometry, Transform
unit_y_29 = UnitY(Factor=Slider(100, range=0..100))
unit_x_21 = UnitX(Factor=Slider(100, range=0..100))
unit_x_22 = UnitX(Factor=expr("-x", Slider(200, range=0..1000)))
unit_x_23 = UnitX(Factor=expr("-x", Slider(200, range=0..1000)))
move_51 = Move(Geometry=evaluate_curve_30.Point, Motion=unit_y_24)  # -> Geometry, Transform
move_52 = Move(Geometry=evaluate_curve_31.Point, Motion=unit_y_25)  # -> Geometry, Transform
line_78 = Line(StartPoint=evaluate_curve_25.Point, EndPoint=move_46.Geometry)
line_79 = Line(StartPoint=evaluate_curve_26.Point, EndPoint=move_47.Geometry)
line_80 = Line(StartPoint=evaluate_curve_27.Point, EndPoint=move_48.Geometry)
move_53 = Move(Geometry=move_46.Geometry, Motion=unit_y_28)  # -> Geometry, Transform
move_54 = Move(Geometry=move_47.Geometry, Motion=unit_y_26)  # -> Geometry, Transform
move_55 = Move(Geometry=move_48.Geometry, Motion=unit_y_27)  # -> Geometry, Transform
line_81 = Line(StartPoint=evaluate_curve_28.Point, EndPoint=move_49.Geometry)
move_56 = Move(Geometry=evaluate_curve_25.Point, Motion=unit_y_28)  # -> Geometry, Transform
move_57 = Move(Geometry=evaluate_curve_26.Point, Motion=unit_y_26)  # -> Geometry, Transform
move_58 = Move(Geometry=move_49.Geometry, Motion=unit_y_29)  # -> Geometry, Transform
move_59 = Move(Geometry=evaluate_curve_27.Point, Motion=unit_y_27)  # -> Geometry, Transform
move_60 = Move(Geometry=evaluate_curve_28.Point, Motion=unit_y_29)  # -> Geometry, Transform
line_82 = Line(StartPoint=evaluate_curve_29.Point, EndPoint=move_50.Geometry)
move_61 = Move(Geometry=move_50.Geometry, Motion=unit_x_21)  # -> Geometry, Transform
move_62 = Move(Geometry=evaluate_curve_29.Point, Motion=unit_x_21)  # -> Geometry, Transform
line_83 = Line(StartPoint=evaluate_curve_30.Point, EndPoint=move_51.Geometry)
line_84 = Line(StartPoint=evaluate_curve_31.Point, EndPoint=move_52.Geometry)
move_63 = Move(Geometry=move_51.Geometry, Motion=unit_x_22)  # -> Geometry, Transform
move_64 = Move(Geometry=move_52.Geometry, Motion=unit_x_23)  # -> Geometry, Transform
move_65 = Move(Geometry=evaluate_curve_30.Point, Motion=unit_x_22)  # -> Geometry, Transform
move_66 = Move(Geometry=evaluate_curve_31.Point, Motion=unit_x_23)  # -> Geometry, Transform
line_85 = Line(StartPoint=move_46.Geometry, EndPoint=move_53.Geometry)
line_86 = Line(StartPoint=evaluate_curve_25.Point, EndPoint=move_56.Geometry)
line_87 = Line(StartPoint=move_47.Geometry, EndPoint=move_54.Geometry)
line_88 = Line(StartPoint=evaluate_curve_26.Point, EndPoint=move_57.Geometry)
line_89 = Line(StartPoint=move_48.Geometry, EndPoint=move_55.Geometry)
line_90 = Line(StartPoint=evaluate_curve_27.Point, EndPoint=move_59.Geometry)
line_91 = Line(StartPoint=move_49.Geometry, EndPoint=move_58.Geometry)
line_92 = Line(StartPoint=evaluate_curve_28.Point, EndPoint=move_60.Geometry)
line_93 = Line(StartPoint=move_50.Geometry, EndPoint=move_61.Geometry)
line_94 = Line(StartPoint=evaluate_curve_29.Point, EndPoint=move_62.Geometry)
line_95 = Line(StartPoint=move_51.Geometry, EndPoint=move_63.Geometry)
line_96 = Line(StartPoint=evaluate_curve_30.Point, EndPoint=move_65.Geometry)
line_97 = Line(StartPoint=move_52.Geometry, EndPoint=move_64.Geometry)
line_98 = Line(StartPoint=evaluate_curve_31.Point, EndPoint=move_66.Geometry)
line_99 = Line(StartPoint=move_53.Geometry, EndPoint=move_56.Geometry)
line_100 = Line(StartPoint=move_54.Geometry, EndPoint=move_57.Geometry)
line_101 = Line(StartPoint=move_55.Geometry, EndPoint=move_59.Geometry)
line_102 = Line(StartPoint=move_58.Geometry, EndPoint=move_60.Geometry)
line_103 = Line(StartPoint=move_61.Geometry, EndPoint=move_62.Geometry)
line_104 = Line(StartPoint=move_63.Geometry, EndPoint=move_65.Geometry)
line_105 = Line(StartPoint=move_64.Geometry, EndPoint=move_66.Geometry)
join_curves_29 = JoinCurves(Curves=[line_78, line_85, line_99, line_86], Preserve=False)
join_curves_30 = JoinCurves(Curves=[line_79, line_87, line_100, line_88], Preserve=False)
join_curves_31 = JoinCurves(Curves=[line_80, line_89, line_101, line_90], Preserve=False)
join_curves_32 = JoinCurves(Curves=[line_81, line_91, line_102, line_92], Preserve=False)
join_curves_33 = JoinCurves(Curves=[line_82, line_93, line_103, line_94], Preserve=False)
join_curves_34 = JoinCurves(Curves=[line_83, line_95, line_104, line_96], Preserve=False)
join_curves_35 = JoinCurves(Curves=[line_84, line_97, line_105, line_98], Preserve=False)
unit_z_29 = UnitZ(Factor=Slider(2500, range=0..10000))
unit_z_30 = UnitZ(Factor=Slider(2500, range=0..10000))
unit_z_31 = UnitZ(Factor=Slider(2500, range=0..10000))
unit_z_32 = UnitZ(Factor=Slider(2500, range=0..10000))
boundary_surfaces_26 = BoundarySurfaces(Edges=join_curves_29)
boundary_surfaces_27 = BoundarySurfaces(Edges=join_curves_30)
boundary_surfaces_28 = BoundarySurfaces(Edges=join_curves_31)
boundary_surfaces_29 = BoundarySurfaces(Edges=join_curves_32)
unit_z_33 = UnitZ(Factor=Slider(2500, range=0..10000))
boundary_surfaces_30 = BoundarySurfaces(Edges=join_curves_33)
unit_z_34 = UnitZ(Factor=Slider(2500, range=0..10000))
unit_z_35 = UnitZ(Factor=Slider(2500, range=0..10000))
boundary_surfaces_31 = BoundarySurfaces(Edges=join_curves_34)
boundary_surfaces_32 = BoundarySurfaces(Edges=join_curves_35)
extrude_27 = Extrude(Base=boundary_surfaces_26, Direction=unit_z_29)
extrude_28 = Extrude(Base=boundary_surfaces_27, Direction=unit_z_30)
extrude_29 = Extrude(Base=boundary_surfaces_28, Direction=unit_z_31)
extrude_30 = Extrude(Base=boundary_surfaces_29, Direction=unit_z_32)
extrude_31 = Extrude(Base=boundary_surfaces_30, Direction=unit_z_33)
extrude_32 = Extrude(Base=boundary_surfaces_31, Direction=unit_z_34)
extrude_33 = Extrude(Base=boundary_surfaces_32, Direction=unit_z_35)
solid_difference_32 = SolidDifference(BrepsA=solid_difference_13, BrepsB=extrude_27)
solid_difference_33 = SolidDifference(BrepsA=solid_difference_18, BrepsB=extrude_28)
solid_difference_34 = SolidDifference(BrepsA=solid_difference_14, BrepsB=extrude_29)
solid_difference_35 = SolidDifference(BrepsA=solid_difference_17, BrepsB=[extrude_30, extrude_32, extrude_33])
solid_difference_36 = SolidDifference(BrepsA=solid_difference_15, BrepsB=extrude_31)

query_materials_4 = QueryMaterials()
list_item_32 = ListItem(Index=Slider(29, range=0..100), Wrap=True)
panel_9 = Panel(list_item_32)
add_geometry_directshape_4 = AddGeometryDirectShape(Name="CARPORT ROOF", Geometry=extrude_13, Material=list_item_32, TrackingMode=2)

# ----
# CARPORT POLES BASE
number_slider_28 = Slider(2, range=0..10)
deconstruct_brep_4 = DeconstructBrep(Brep=cap_holes)  # -> Faces, Edges, Vertices
list_item_33 = ListItem(List=deconstruct_brep_4.Faces, Index=number_slider_28, Wrap=True)
area_3 = Area(Geometry=list_item_33)  # -> Area, Centroid
unit_z_36 = UnitZ(Factor=expr("-x", Slider(600, range=0..1000)))
circle_2 = Circle(Plane=area_3.Centroid, Radius=Slider(250, range=0..1000))
extrude_34 = Extrude(Base=circle_2, Direction=unit_z_36)
cap_holes_2 = CapHoles(Brep=extrude_34)

query_materials_5 = QueryMaterials()
list_item_34 = ListItem(Index=Slider(60, range=0..100), Wrap=True)
panel_10 = Panel(list_item_34)
add_geometry_directshape_5 = AddGeometryDirectShape(Name="CARPORT COLUMN", Geometry=cap_holes, Material=list_item_34, TrackingMode=2)

custom_preview_5 = CustomPreview(Geometry=[cap_holes_2, cap_holes], Material=ColourSwatch(SwatchColor=RGB(89, 89, 89)))

query_materials_6 = QueryMaterials()
list_item_35 = ListItem(Index=Slider(73, range=0..100), Wrap=True)
panel_11 = Panel(list_item_35)
add_geometry_directshape_6 = AddGeometryDirectShape(Name="CARPORT COLUMN FOUNDATION", Geometry=cap_holes_2, Material=list_item_35, TrackingMode=2)

query_materials_7 = QueryMaterials()
list_item_36 = ListItem(Index=Slider(46, range=0..100), Wrap=True)
panel_12 = Panel(list_item_36)
add_geometry_directshape_7 = AddGeometryDirectShape(Name="EXTERIOR WALLS", Geometry=solid_difference_29, Material=list_item_36, TrackingMode=2)

custom_preview_6 = CustomPreview(
    Geometry=[solid_difference_34, solid_difference_32, solid_difference_33, solid_difference_35, solid_difference_36, solid_difference_16, solid_difference_20, solid_difference_19],
    Material=ColourSwatch(SwatchColor=RGB(255, 255, 255)))

deconstruct_brep_5 = DeconstructBrep(Brep=solid_difference_34)  # -> Faces, Edges, Vertices
deconstruct_brep_6 = DeconstructBrep(Brep=solid_difference_32)  # -> Faces, Edges, Vertices

custom_preview_7 = CustomPreview(Geometry=solid_difference_29, Material=ColourSwatch(SwatchColor=RGB(153, 153, 153)))

merge = Merge(
    Data1=solid_difference_34,
    Data2=solid_difference_32,
    Data3=solid_difference_33,
    Data4=solid_difference_35,
    Data5=solid_difference_36,
    Data6=solid_difference_20,
    Data7=solid_difference_19,
    Data8=solid_difference_16)
list_item_37 = ListItem(List=deconstruct_brep_5.Faces, Index=Slider(1, range=0..100), Wrap=True)
list_item_38 = ListItem(List=deconstruct_brep_5.Faces, Index=Slider(4, range=0..10), Wrap=True)
list_item_39 = ListItem(List=deconstruct_brep_6.Faces, Index=Slider(1, range=0..10), Wrap=True)
list_item_40 = ListItem(List=deconstruct_brep_6.Faces, Index=Slider(4, range=0..10), Wrap=True)
deconstruct_brep_7 = DeconstructBrep(Brep=list_item_37)  # -> Faces, Edges, Vertices
extrude_35 = Extrude(Base=list_item_38, Direction=unit_x)
extrude_36 = Extrude(Base=list_item_39, Direction=unit_y_2)
extrude_37 = Extrude(Base=list_item_40, Direction=unit_x_2)

# ----
# WINDOW GLAZING
number_slider_29 = Slider(200, range=0..1000)
explode_15 = Explode(Curve=move_2.Geometry, Recursive=True)  # -> Segments, Vertices
evaluate_curve_32 = EvaluateCurve(Curve=offset_curve, Parameter=number_slider_16)  # -> Point, Tangent, Angle
evaluate_curve_33 = EvaluateCurve(Curve=offset_curve, Parameter=number_slider_17)  # -> Point, Tangent, Angle
evaluate_curve_34 = EvaluateCurve(Curve=offset_curve, Parameter=number_slider_18)  # -> Point, Tangent, Angle
evaluate_curve_35 = EvaluateCurve(Curve=offset_curve, Parameter=number_slider_20)  # -> Point, Tangent, Angle
list_item_41 = ListItem(List=explode_15.Vertices, Index="3", Wrap=True)
unit_x_24 = UnitX(Factor=number_slider_29)
evaluate_curve_36 = EvaluateCurve(Curve=offset_curve, Parameter=number_slider_21)  # -> Point, Tangent, Angle
evaluate_curve_37 = EvaluateCurve(Curve=offset_curve, Parameter=number_slider_19)  # -> Point, Tangent, Angle
evaluate_curve_38 = EvaluateCurve(Curve=offset_curve, Parameter=number_slider_22)  # -> Point, Tangent, Angle
evaluate_curve_39 = EvaluateCurve(Curve=offset_curve, Parameter=number_slider_23)  # -> Point, Tangent, Angle
evaluate_curve_40 = EvaluateCurve(Curve=offset_curve, Parameter=number_slider_24)  # -> Point, Tangent, Angle
evaluate_curve_41 = EvaluateCurve(Curve=offset_curve, Parameter=number_slider_25)  # -> Point, Tangent, Angle
unit_x_25 = UnitX(Factor=expr("-x", Slider(300, range=0..1000)))
unit_y_30 = UnitY(Factor=expr("-x", Slider(300, range=0..1000)))
unit_x_26 = UnitX(Factor=expr("-x", Slider(300, range=0..1000)))
unit_x_27 = UnitX(Factor=expr("-x", Slider(300, range=0..1000)))
move_67 = Move(Geometry=list_item_41, Motion=expr("-x", unit_x_24))  # -> Geometry, Transform
unit_y_31 = UnitY(Factor=Slider(300, range=0..1000))
unit_y_32 = UnitY(Factor=Slider(300, range=0..1000))
unit_x_28 = UnitX(Factor=Slider(300, range=0..1000))
unit_y_33 = UnitY(Factor=Slider(300, range=0..1000))
unit_x_29 = UnitX(Factor=Slider(300, range=0..1000))
unit_y_34 = UnitY(Factor=Slider(300, range=0..1000))
number_slider_30 = Slider(300, range=0..1000)
move_68 = Move(Geometry=evaluate_curve_32.Point, Motion=unit_y_30)  # -> Geometry, Transform
move_69 = Move(Geometry=evaluate_curve_33.Point, Motion=unit_x_25)  # -> Geometry, Transform
move_70 = Move(Geometry=evaluate_curve_34.Point, Motion=unit_x_26)  # -> Geometry, Transform
move_71 = Move(Geometry=evaluate_curve_35.Point, Motion=unit_x_27)  # -> Geometry, Transform
evaluate_curve_42 = EvaluateCurve(Curve=offset_curve, Parameter=number_slider_15)  # -> Point, Tangent, Angle
move_72 = Move(Geometry=evaluate_curve_36.Point, Motion=unit_y_31)  # -> Geometry, Transform
unit_x_30 = UnitX(Factor=Slider(200, range=0..1000))
move_73 = Move(Geometry=evaluate_curve_37.Point, Motion=unit_y_32)  # -> Geometry, Transform
move_74 = Move(Geometry=move_13.Geometry, Motion=expr("-x", unit_x_30))  # -> Geometry, Transform
unit_y_35 = UnitY(Factor=Slider(200, range=0..1000))
move_75 = Move(Geometry=move_12.Geometry, Motion=expr("-x", unit_y_35))  # -> Geometry, Transform
move_76 = Move(Geometry=evaluate_curve_38.Point, Motion=unit_y_33)  # -> Geometry, Transform
unit_x_31 = UnitX(Factor=Slider(200, range=0..1000))
move_77 = Move(Geometry=move_14.Geometry, Motion=expr("-x", unit_x_31))  # -> Geometry, Transform
move_78 = Move(Geometry=evaluate_curve_39.Point, Motion=unit_y_34)  # -> Geometry, Transform
move_79 = Move(Geometry=evaluate_curve_40.Point, Motion=unit_x_28)  # -> Geometry, Transform
unit_x_32 = UnitX(Factor=Slider(200, range=0..1000))
move_80 = Move(Geometry=evaluate_curve_41.Point, Motion=unit_x_29)  # -> Geometry, Transform
move_81 = Move(Geometry=move_15.Geometry, Motion=expr("-x", unit_x_32))  # -> Geometry, Transform
unit_y_36 = UnitY(Factor=Slider(200, range=0..1000))
unit_y_37 = UnitY(Factor=Slider(200, range=0..1000))
unit_y_38 = UnitY(Factor=Slider(200, range=0..1000))
move_82 = Move(Geometry=move_17.Geometry, Motion=unit_y_36)  # -> Geometry, Transform
move_83 = Move(Geometry=move_16.Geometry, Motion=unit_y_37)  # -> Geometry, Transform
move_84 = Move(Geometry=move_18.Geometry, Motion=unit_y_38)  # -> Geometry, Transform
unit_y_39 = UnitY(Factor=Slider(200, range=0..1000))
unit_x_33 = UnitX(Factor=Slider(200, range=0..1000))
unit_x_34 = UnitX(Factor=Slider(200, range=0..1000))
move_85 = Move(Geometry=move_19.Geometry, Motion=unit_y_39)  # -> Geometry, Transform
move_86 = Move(Geometry=move_20.Geometry, Motion=unit_x_33)  # -> Geometry, Transform
move_87 = Move(Geometry=move_21.Geometry, Motion=unit_x_34)  # -> Geometry, Transform
unit_y_40 = UnitY(Factor=expr("-x", number_slider_30))
move_88 = Move(Geometry=evaluate_curve_32.Point, Motion=expr("-x", unit_y_35))  # -> Geometry, Transform
move_89 = Move(Geometry=evaluate_curve_33.Point, Motion=expr("-x", unit_x_30))  # -> Geometry, Transform
move_90 = Move(Geometry=move_25.Geometry, Motion=unit_y_35)  # -> Geometry, Transform
move_91 = Move(Geometry=move_27.Geometry, Motion=unit_x_30)  # -> Geometry, Transform
vector_xyz = VectorXYZ(XComponent=expr("-x", Slider(100, range=0..100)), YComponent=number_slider_30, ZComponent=0)  # -> Vector, Length
move_92 = Move(Geometry=evaluate_curve_34.Point, Motion=expr("-x", unit_x_31))  # -> Geometry, Transform
move_93 = Move(Geometry=evaluate_curve_35.Point, Motion=expr("-x", unit_x_32))  # -> Geometry, Transform
move_94 = Move(Geometry=move_29.Geometry, Motion=unit_x_31)  # -> Geometry, Transform
line_106 = Line(StartPoint=move_88.Geometry, EndPoint=move_68.Geometry)
line_107 = Line(StartPoint=move_89.Geometry, EndPoint=move_69.Geometry)
move_95 = Move(Geometry=move_31.Geometry, Motion=unit_x_32)  # -> Geometry, Transform
line_108 = Line(StartPoint=move_92.Geometry, EndPoint=move_70.Geometry)
move_96 = Move(Geometry=move_33.Geometry, Motion=expr("-x", unit_y_36))  # -> Geometry, Transform
move_97 = Move(Geometry=move_32.Geometry, Motion=expr("-x", unit_y_37))  # -> Geometry, Transform
unit_x_35 = UnitX(Factor=Slider(200, range=0..1000))
line_109 = Line(StartPoint=move_93.Geometry, EndPoint=move_71.Geometry)
move_98 = Move(Geometry=move_37.Geometry, Motion=expr("-x", unit_y_38))  # -> Geometry, Transform
move_99 = Move(Geometry=evaluate_curve_36.Point, Motion=unit_y_36)  # -> Geometry, Transform
move_100 = Move(Geometry=evaluate_curve_37.Point, Motion=unit_y_37)  # -> Geometry, Transform
move_101 = Move(Geometry=evaluate_curve_38.Point, Motion=unit_y_38)  # -> Geometry, Transform
move_102 = Move(Geometry=move_39.Geometry, Motion=expr("-x", unit_y_39))  # -> Geometry, Transform
move_103 = Move(Geometry=move_41.Geometry, Motion=expr("-x", unit_x_33))  # -> Geometry, Transform
move_104 = Move(Geometry=move_44.Geometry, Motion=expr("-x", unit_x_34))  # -> Geometry, Transform
line_110 = Line(StartPoint=move_99.Geometry, EndPoint=move_72.Geometry)
line_111 = Line(StartPoint=move_100.Geometry, EndPoint=move_73.Geometry)
move_105 = Move(Geometry=evaluate_curve_39.Point, Motion=unit_y_39)  # -> Geometry, Transform
move_106 = Move(Geometry=evaluate_curve_40.Point, Motion=unit_x_33)  # -> Geometry, Transform
line_112 = Line(StartPoint=move_101.Geometry, EndPoint=move_76.Geometry)
move_107 = Move(Geometry=evaluate_curve_41.Point, Motion=unit_x_34)  # -> Geometry, Transform
line_113 = Line(StartPoint=move_105.Geometry, EndPoint=move_78.Geometry)
line_114 = Line(StartPoint=move_106.Geometry, EndPoint=move_79.Geometry)
move_108 = Move(Geometry=evaluate_curve_42.Point, Motion=unit_y_40)  # -> Geometry, Transform
line_115 = Line(StartPoint=move_107.Geometry, EndPoint=move_80.Geometry)
unit_y_41 = UnitY(Factor=Slider(200, range=0..1000))
move_109 = Move(Geometry=move_67.Geometry, Motion=vector_xyz.Vector)  # -> Geometry, Transform
point_2 = Point(move_23.Geometry)
point_3 = Point(move_43.Geometry)
line_116 = Line(StartPoint=move_68.Geometry, EndPoint=move_90.Geometry)
line_117 = Line(StartPoint=move_88.Geometry, EndPoint=move_75.Geometry)
line_118 = Line(StartPoint=move_69.Geometry, EndPoint=move_91.Geometry)
line_119 = Line(StartPoint=move_89.Geometry, EndPoint=move_74.Geometry)
line_120 = Line(StartPoint=move_70.Geometry, EndPoint=move_94.Geometry)
line_121 = Line(StartPoint=move_92.Geometry, EndPoint=move_77.Geometry)
line_122 = Line(StartPoint=move_71.Geometry, EndPoint=move_95.Geometry)
line_123 = Line(StartPoint=move_93.Geometry, EndPoint=move_81.Geometry)
line_124 = Line(StartPoint=move_72.Geometry, EndPoint=move_96.Geometry)
line_125 = Line(StartPoint=move_99.Geometry, EndPoint=move_82.Geometry)
line_126 = Line(StartPoint=move_73.Geometry, EndPoint=move_97.Geometry)
line_127 = Line(StartPoint=move_100.Geometry, EndPoint=move_83.Geometry)
line_128 = Line(StartPoint=move_76.Geometry, EndPoint=move_98.Geometry)
line_129 = Line(StartPoint=move_101.Geometry, EndPoint=move_84.Geometry)
line_130 = Line(StartPoint=move_78.Geometry, EndPoint=move_102.Geometry)
line_131 = Line(StartPoint=move_105.Geometry, EndPoint=move_85.Geometry)
line_132 = Line(StartPoint=move_79.Geometry, EndPoint=move_103.Geometry)
line_133 = Line(StartPoint=move_106.Geometry, EndPoint=move_86.Geometry)
line_134 = Line(StartPoint=move_80.Geometry, EndPoint=move_104.Geometry)
line_135 = Line(StartPoint=move_107.Geometry, EndPoint=move_87.Geometry)
move_110 = Move(Geometry=point_3, Motion=expr("-x", unit_x_35))  # -> Geometry, Transform
move_111 = Move(Geometry=evaluate_curve_42.Point, Motion=expr("-x", unit_y_41))  # -> Geometry, Transform
move_112 = Move(Geometry=point_2, Motion=unit_x_35)  # -> Geometry, Transform
line_136 = Line(StartPoint=move_90.Geometry, EndPoint=move_75.Geometry)
line_137 = Line(StartPoint=move_91.Geometry, EndPoint=move_74.Geometry)
move_113 = Move(Geometry=move_67.Geometry, Motion=unit_y_41)  # -> Geometry, Transform
line_138 = Line(StartPoint=move_94.Geometry, EndPoint=move_77.Geometry)
line_139 = Line(StartPoint=move_95.Geometry, EndPoint=move_81.Geometry)
line_140 = Line(StartPoint=move_111.Geometry, EndPoint=move_108.Geometry)
line_141 = Line(StartPoint=move_96.Geometry, EndPoint=move_82.Geometry)
line_142 = Line(StartPoint=move_97.Geometry, EndPoint=move_83.Geometry)
line_143 = Line(StartPoint=move_98.Geometry, EndPoint=move_84.Geometry)
line_144 = Line(StartPoint=move_102.Geometry, EndPoint=move_85.Geometry)
line_145 = Line(StartPoint=move_103.Geometry, EndPoint=move_86.Geometry)
line_146 = Line(StartPoint=move_104.Geometry, EndPoint=move_87.Geometry)
join_curves_36 = JoinCurves(Curves=[line_106, line_116, line_136, line_117], Preserve=False)
join_curves_37 = JoinCurves(Curves=[line_107, line_118, line_137, line_119], Preserve=False)
join_curves_38 = JoinCurves(Curves=[line_108, line_120, line_138, line_121], Preserve=False)
join_curves_39 = JoinCurves(Curves=[line_109, line_122, line_139, line_123], Preserve=False)
line_147 = Line(StartPoint=move_108.Geometry, EndPoint=move_113.Geometry)
line_148 = Line(StartPoint=move_111.Geometry, EndPoint=move_109.Geometry)
line_149 = Line(StartPoint=move_113.Geometry, EndPoint=move_110.Geometry)
line_150 = Line(StartPoint=move_109.Geometry, EndPoint=move_112.Geometry)
line_151 = Line(StartPoint=move_112.Geometry, EndPoint=move_110.Geometry)
join_curves_40 = JoinCurves(Curves=[line_110, line_124, line_141, line_125], Preserve=False)
join_curves_41 = JoinCurves(Curves=[line_111, line_126, line_142, line_127], Preserve=False)
join_curves_42 = JoinCurves(Curves=[line_112, line_128, line_143, line_129], Preserve=False)
join_curves_43 = JoinCurves(Curves=[line_113, line_130, line_144, line_131], Preserve=False)
join_curves_44 = JoinCurves(Curves=[line_114, line_132, line_145, line_133], Preserve=False)
join_curves_45 = JoinCurves(Curves=[line_115, line_134, line_146, line_135], Preserve=False)
boundary_surfaces_33 = BoundarySurfaces(Edges=join_curves_36)
boundary_surfaces_34 = BoundarySurfaces(Edges=join_curves_37)
boundary_surfaces_35 = BoundarySurfaces(Edges=join_curves_38)
boundary_surfaces_36 = BoundarySurfaces(Edges=join_curves_39)
boundary_surfaces_37 = BoundarySurfaces(Edges=join_curves_40)
boundary_surfaces_38 = BoundarySurfaces(Edges=join_curves_41)
boundary_surfaces_39 = BoundarySurfaces(Edges=join_curves_42)
boundary_surfaces_40 = BoundarySurfaces(Edges=join_curves_43)
boundary_surfaces_41 = BoundarySurfaces(Edges=join_curves_44)
boundary_surfaces_42 = BoundarySurfaces(Edges=join_curves_45)
join_curves_46 = JoinCurves(Curves=[line_140, line_147, line_148, line_149, line_150, line_151], Preserve=False)
boundary_surfaces_43 = BoundarySurfaces(Edges=join_curves_46)
unit_z_37 = UnitZ(Factor=Slider(2350, range=0..10000))
extrude_38 = Extrude(Base=boundary_surfaces_43, Direction=unit_z_37)

join_curves_47 = JoinCurves(Curves=deconstruct_brep_7.Edges, Preserve=False)
panel_13 = Panel(extrude_35)
boundary_surfaces_44 = BoundarySurfaces(Edges=join_curves_47)
extrude_39 = Extrude(Base=boundary_surfaces_44, Direction=unit_y)
merge_2 = Merge(Data2=solid_difference_16, Data3=solid_difference_36, Data4=solid_difference_19)  # -> graft(Result)
solid_union = SolidUnion(Breps=[solid_difference_35, solid_difference_20])
solid_union_2 = SolidUnion(Breps=[extrude_37, solid_difference_33])

query_materials_8 = QueryMaterials()
list_item_42 = ListItem(Index=Slider(56, range=0..100), Wrap=True)
panel_14 = Panel(list_item_42)
add_geometry_directshape_8 = AddGeometryDirectShape(Name="INTERIOR WALLS", Geometry=extrude_39, Material=list_item_42, TrackingMode=2)

query_materials_9 = QueryMaterials()
list_item_43 = ListItem(Index=Slider(56, range=0..100), Wrap=True)
panel_15 = Panel(list_item_43)
add_geometry_directshape_9 = AddGeometryDirectShape(Name="INTERIOR WALLS", Geometry=extrude_35, Material=list_item_43, TrackingMode=2)

query_materials_10 = QueryMaterials()
list_item_44 = ListItem(Index=Slider(56, range=0..100), Wrap=True)
panel_16 = Panel(list_item_44)
add_geometry_directshape_10 = AddGeometryDirectShape(Name="INTERIOR WALLS", Geometry=extrude_36, Material=list_item_44, TrackingMode=2)

query_materials_11 = QueryMaterials()
list_item_45 = ListItem(Index=Slider(56, range=0..100), Wrap=True)
panel_17 = Panel(list_item_45)
add_geometry_directshape_11 = AddGeometryDirectShape(Name="INTERIOR WALLS", Geometry=solid_union_2, Material=list_item_45, TrackingMode=2)

query_materials_12 = QueryMaterials()
list_item_46 = ListItem(Index=Slider(56, range=0..100), Wrap=True)
panel_18 = Panel(list_item_46)
add_geometry_directshape_12 = AddGeometryDirectShape(Name="INTERIOR WALLS", Geometry=merge_2, Material=list_item_46, TrackingMode=2)

query_materials_13 = QueryMaterials()
list_item_47 = ListItem(Index=Slider(56, range=0..100), Wrap=True)
panel_19 = Panel(list_item_47)
add_geometry_directshape_13 = AddGeometryDirectShape(Name="INTERIOR WALLS", Geometry=solid_union, Material=list_item_47, TrackingMode=2)

# ----
# WINDOW GLAZING/PANELS
number_slider_31 = Slider(1200, range=0..10000)
unit_z_38 = UnitZ(Factor=number_slider_31)
extrude_40 = Extrude(
    Base=[boundary_surfaces_33, boundary_surfaces_34, boundary_surfaces_35, boundary_surfaces_36, boundary_surfaces_37, boundary_surfaces_39, boundary_surfaces_40, boundary_surfaces_41, boundary_surfaces_42],
    Direction=unit_z_38)
number_slider_32 = Slider(1150, range=0..10000)
deconstruct_brep_8 = DeconstructBrep(Brep=extrude_40)  # -> Faces, Edges, Vertices
unit_z_39 = UnitZ(Factor=number_slider_32)
list_item_48 = ListItem(List=deconstruct_brep_8.Faces, Index=Slider(5, range=0..10), Wrap=True)
extrude_41 = Extrude(Base=list_item_48, Direction=unit_z_39)
addition = Addition(A=number_slider_31, B=number_slider_32)
brep_join = BrepJoin(Breps=extrude_38)  # -> Breps, Closed
unit_z_40 = UnitZ(Factor=addition)
deconstruct_brep_9 = DeconstructBrep(Brep=brep_join.Breps)  # -> Faces, Edges, Vertices
deconstruct_brep_10 = DeconstructBrep(Brep=extrude_41)  # -> Faces, Edges, Vertices
move_114 = Move(Geometry=boundary_surfaces_38, Motion=unit_z_40)  # -> Geometry, Transform
unit_z_41 = UnitZ(Factor=Slider(1680, range=0..10000))
list_item_49 = ListItem(List=deconstruct_brep_9.Faces, Index=Slider(7, range=0..10), Wrap=True)
unit_z_42 = UnitZ(Factor=Slider(3200, range=0..10000))
list_item_50 = ListItem(List=deconstruct_brep_10.Faces, Index=Slider(5, range=0..10), Wrap=True)
extrude_42 = Extrude(Base=[list_item_49, move_114.Geometry], Direction=unit_z_41)
extrude_43 = Extrude(Base=list_item_50, Direction=unit_z_42)
solid_difference_37 = SolidDifference(BrepsA=[extrude_43, extrude_42], BrepsB=rotate_axis.Geometry)
solid_difference_38 = SolidDifference(BrepsA=[extrude_43, extrude_42], BrepsB=solid_difference_37)

# ----
# WINDOW BEAM/COLUMN
number_slider_33 = Slider(150, range=0..1000)
number_slider_34 = Slider(200, range=0..1000)
explode_16 = Explode(Curve=boundary_surfaces_43, Recursive=True)  # -> Segments, Vertices
rectangle_4 = Rectangle(Plane=PlaneXY(0, 0, 0), XSize=number_slider_33, YSize=number_slider_34, Radius=0)  # -> Rectangle, Length
explode_17 = Explode(Curve=rectangle_4.Rectangle, Recursive=True)  # -> Segments, Vertices
list_item_51 = ListItem(List=explode_16.Vertices, Index=Slider(5, range=0..10), Wrap=True)
list_item_52 = ListItem(List=explode_17.Vertices, Index=Slider(2, range=0..10), Wrap=True)
vector_2pt_3 = Vector2Pt(PointA=list_item_52, PointB=list_item_51, Unitize=False)  # -> Vector, Length
move_115 = Move(Geometry=rectangle_4.Rectangle, Motion=vector_2pt_3.Vector)  # -> Geometry, Transform
deconstruct_brep_11 = DeconstructBrep(Brep=extrude_13)  # -> Faces, Edges, Vertices
unit_z_43 = UnitZ(Factor=Slider(6000, range=0..10000))
boundary_surfaces_45 = BoundarySurfaces(Edges=move_115.Geometry)
unit_y_42 = UnitY(Factor=number_slider_34)
list_item_53 = ListItem(List=deconstruct_brep_11.Faces, Index=Slider(9, range=0..10), Wrap=True)
extrude_44 = Extrude(Base=boundary_surfaces_45, Direction=unit_z_43)
extrude_45 = Extrude(Base=list_item_53, Direction=unit_y_42)
solid_difference_39 = SolidDifference(BrepsA=extrude_44, BrepsB=rotate_axis.Geometry)
solid_difference_40 = SolidDifference(BrepsA=extrude_45, BrepsB=solid_difference_29)
solid_difference_41 = SolidDifference(BrepsA=extrude_44, BrepsB=solid_difference_39)

deconstruct_brep_12 = DeconstructBrep(Brep=extrude_41)  # -> Faces, Edges, Vertices
list_item_54 = ListItem(List=deconstruct_brep_12.Faces, Index=Slider(3, range=0..10), Wrap=True)
curve = Curve(list_item_54)
boundary_surfaces_46 = BoundarySurfaces(Edges=curve)
polyline_offset = PolylineOffset(
    Polylines=curve,
    Distance=Slider(50, range=0..100),
    Plane=Plane(origin=(0, 0, 0), x=(0, 0, 0), y=(0, 0, 0)),
    Tolerance=0.01,
    ClosedFillet=2,
    OpenFillet=2,
    Miter=2)  # -> Contour, Holes
curve_2 = Curve(polyline_offset.Holes)
boundary_surfaces_47 = BoundarySurfaces(Edges=curve_2)
solid_difference_42 = SolidDifference(BrepsA=boundary_surfaces_47, BrepsB=boundary_surfaces_46)
solid_difference_43 = SolidDifference(BrepsA=boundary_surfaces_47, BrepsB=solid_difference_42)  # -> flatten(Result)
list_item_55 = ListItem(List=solid_difference_43, Index=0, Wrap=True)
list_item_56 = ListItem(List=solid_difference_43, Index=panel, Wrap=True)
list_item_57 = ListItem(List=solid_difference_43, Index=panel_2, Wrap=True)
list_item_58 = ListItem(List=solid_difference_43, Index=panel_3, Wrap=True)
extrude_46 = Extrude(Base=list_item_58, Direction=unit_x_3)
extrude_47 = Extrude(Base=list_item_55, Direction=unit_y_3)
extrude_48 = Extrude(Base=list_item_56, Direction=unit_y_4)
extrude_49 = Extrude(Base=list_item_57, Direction=unit_x_4)
solid_union_3 = SolidUnion(Breps=[solid_difference_41, solid_difference_40])

query_materials_14 = QueryMaterials()
list_item_59 = ListItem(Index=Slider(40, range=0..100), Wrap=True)
panel_20 = Panel(list_item_59)
add_geometry_directshape_14 = AddGeometryDirectShape(Name="WINDOW COLUMN", Geometry=solid_union_3, Material=list_item_59, TrackingMode=2)

custom_preview_8 = CustomPreview(Geometry=[extrude_47, extrude_46, extrude_48, extrude_49], Material=ColourSwatch(SwatchColor=RGB(0, 0, 0)))
merge_3 = Merge(
    Data1=flatten(extrude_4),
    Data2=flatten(extrude_2),
    Data3=flatten(extrude),
    Data4=flatten(cap_holes),
    Data5=flatten(cap_holes_2),
    Data6=flatten(extrude_13),
    Data7=flatten(merge),
    Data8=flatten(solid_difference_29),
    Data9=flatten(solid_difference_41),
    Data10=flatten(solid_difference_40),
    Data11=flatten(extrude_46),
    Data12=flatten(extrude_47),
    Data13=flatten(extrude_48),
    Data14=flatten(extrude_49),
    Data15=flatten(solid_difference_38),
    Data16=flatten(extrude_40),
    Data17=flatten(extrude_38),
    Data18=flatten(extrude_41))  # -> graft(Result)

custom_preview_9 = CustomPreview(Geometry=[solid_difference_40, solid_difference_41], Material=ColourSwatch(SwatchColor=RGB(198, 209, 136)))

custom_preview_10 = CustomPreview(Geometry=[extrude_40, solid_difference_38], Material=ColourSwatch(SwatchColor=RGB(255, 140, 0)))

query_materials_15 = QueryMaterials()
list_item_60 = ListItem(Index=Slider(65, range=0..100), Wrap=True)
panel_21 = Panel(list_item_60)
add_geometry_directshape_15 = AddGeometryDirectShape(Name="WINDOW PANELLING", Geometry=[solid_difference_38, extrude_40], Material=list_item_60, TrackingMode=2)

query_materials_16 = QueryMaterials()
list_item_61 = ListItem(Index=Slider(3, range=0..100), Wrap=True)
panel_22 = Panel(list_item_61)
add_geometry_directshape_16 = AddGeometryDirectShape(Name="WINDOWS", Geometry=[extrude_41, extrude_38], Material=list_item_61, TrackingMode=2)

query_materials_17 = QueryMaterials()
list_item_62 = ListItem(Index=Slider(40, range=0..100), Wrap=True)
panel_23 = Panel(list_item_62)
add_geometry_directshape_17 = AddGeometryDirectShape(Name="WINDOW FRAMES", Geometry=[extrude_46, extrude_47, extrude_48, extrude_49], Material=list_item_62, TrackingMode=2)

ggifc_representationmap = GgIFCRepresentationMap(IfcRepresentationItems=merge_3)

custom_preview_11 = CustomPreview(Geometry=[extrude_41, extrude_38], Material=ColourSwatch(SwatchColor=RGBA(18, 180, 255, 10)))

ggifc_building_element_proxy_type = GgIFCBuildingElementProxyType(PredefinedType=6, IfcRep=ggifc_representationmap, Name="nurbs house")
ggifc_create_element = GgIFCCreateElement(IFCContainer=ggifc_building, IfcProductType=ggifc_building_element_proxy_type, Location=xy_plane)

# ---- group: test geometry
brep = Brep([extrude_41, solid_difference_38, extrude_40, extrude_38, solid_difference_41, solid_difference_29, cap_holes, cap_holes_2, extrude_13, extrude, extrude_4, extrude_2])  # disabled

# ----
# RADIATION ANALYSIS
ladybug = Ladybug_Ladybug()  # -> Vviiiiiiiiiizzz; disabled; plug-in component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
panel_24 = Panel("https://energyplus-weather.s3.amazonaws.com/southwest_pacific_wmo_region_5/AUS/AUS_NSW.Sydney.947670_IWEC/AUS_NSW.Sydney.947670_IWEC.zip")  # disabled
panel_25 = Panel(ladybug)  # disabled
epw_stat = Ladybug_OpenEPWAndSTATWeatherFiles(weatherFileURL=panel_24)  # -> epwFile, statFile; disabled; plug-in component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
toggle_2 = BooleanToggle(True)  # disabled
gencumulativeskymtx = Ladybug_GenCumulativeSkyMtx(epwFile=epw_stat.epwFile, skyDensity=0, useOldRes=True, runIt=toggle_2)  # -> readMe, cumulativeSkyMtx; disabled; plug-in component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
selectskymtx = Ladybug_selectSkyMtx(cumulativeSkyMtx=gencumulativeskymtx.cumulativeSkyMtx, removeDiffuse=False, removeDirect=False)  # -> readMe, selectedSkyMtx; disabled; plug-in component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
number_slider_35 = Slider(100, range=0..100)  # disabled
toggle_3 = BooleanToggle(True)  # disabled
panel_26 = Panel(".01")  # disabled
radiationanalysis = Ladybug_RadiationAnalysis(
    geometry=flatten(brep),
    gridSize=number_slider_35,
    disFromBase=panel_26,
    selectedSkyMtx=flatten(selectskymtx.selectedSkyMtx),
    parallel=toggle_3,
    runIt=toggle_3)  # -> readMe, contextMesh, analysisMesh, testPts, testVec, port, radiationResult, radiationMesh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; disabled; plug-in component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

# ----
# DIRECT SUN HOURS ANALYSIS
number_slider_36 = Slider(12, range=0..12)  # disabled
number_slider_37 = Slider(21, range=0..31)  # disabled
number_slider_38 = Slider(12, range=0..23)  # disabled
panel_27 = Panel("12")  # disabled
panel_28 = Panel("21")  # disabled
analysisperiod = LBAnalysisPeriod(start_month=panel_27, start_day=panel_28, start_hour=0, end_month=panel_27, end_day=panel_28)  # -> period, hoys, dates; disabled; plug-in component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
hoy = LBCalculateHOY(month=number_slider_36, day=number_slider_37, hour=number_slider_38)  # -> flatten(hoy), flatten(doy), flatten(date); disabled; plug-in component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
number_slider_39 = Slider(0.5, range=0..1)  # disabled
importloc = LBImportLocation(epw_file=epw_stat.epwFile)  # -> location; disabled; plug-in component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
sunpath = LBSunPath(location=importloc, hoys=analysisperiod.hoys, center_pt=area_2.Centroid, scale=number_slider_39)  # -> out, vectors, altitudes, azimuths, hoys, sun_pts, analemma, daily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; disabled; plug-in component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
colour_swatch = ColourSwatch(SwatchColor=RGB(0, 0, 0))  # disabled
number_slider_40 = Slider(1, range=0..100)  # disabled
number_slider_41 = Slider(100, range=0..100)  # disabled
custom_preview_12 = CustomPreview(Geometry=[sunpath.legend, sunpath.title, sunpath.compass, sunpath.daily, sunpath.analemma], Material=colour_swatch)  # disabled
boolean_toggle = BooleanToggle(True)  # disabled
directsunhours = LBDirectSunHours(
    vectors=flatten(sunpath.vectors),
    geometry=flatten(brep),
    grid_size=number_slider_41,
    offset_dist=number_slider_40,
    run=boolean_toggle)  # -> out, points, results, mesh, legend, title, int_mtx; disabled; plug-in component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

# ----
# WINDROSE ANALYSIS
importepw = LBImportEPW(epw_file=epw_stat.epwFile)  # -> location, dry_bulb_temperature, dew_point_temperature, relative_humidity, wind_speed, wind_direction, direct_normal_rad, diffuse_horizontal_rad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; disabled; plug-in component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
windrose = LBWindRose(data=importepw.wind_speed, wind_direction=importepw.wind_direction, center_pt=area_2.Centroid)  # -> out, mesh, compass, orient_line, freq_line, windrose_line, legend, title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; disabled; plug-in component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
colour_swatch_2 = ColourSwatch(SwatchColor=RGB(0, 0, 0))  # disabled
custom_preview_13 = CustomPreview(
    Geometry=[windrose.title, windrose.windrose_line, windrose.compass, windrose.orient_line, windrose.freq_line, windrose.legend],
    Material=colour_swatch_2)  # disabled

forwardraytracing = Ladybug_ForwardRaytracing(
    startPts=sunpath.sun_pts,
    startVectors=graft(sunpath.vectors),
    context=flatten(brep),
    numOfBounce=number_slider_4,
    lastBounceLen=number_slider_6)  # -> rays; disabled; plug-in component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
bouncefromsurface = Ladybug_BounceFromSurface(
    sourceSrfs=brep,
    gridSizeOrPoints=flatten(number_slider),
    sunVectors=graft(sunpath.vectors),
    numOfBounce=number_slider_3,
    lastBounceLen=number_slider_2,
    firstBounceLen=number_slider_5,
    runIt=toggle)  # -> simplify(rays), bouncePts; disabled; plug-in component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
preview = CustomPreview(Geometry=forwardraytracing, Shader=swatch)  # disabled
preview_2 = CustomPreview(Geometry=bouncefromsurface.rays, Shader=swatch_2)  # disabled
